% Simulink data dictionary Based_FOC_Data.sldd

Sig = Simulink.Signal()
Period = Simulink.Parameter(8500, StorageClass="Define")  % SVPWM周期，中心堆成模式，定时器周期乘以二
Udc = Simulink.Parameter(300, StorageClass="Define", DataType="double")
Pn = Simulink.Parameter(4, StorageClass="Define")
L = Simulink.Parameter(0.002075, StorageClass="Define", DataType="double")
sin_theta = Simulink.Signal(StorageClass="ExportedGlobal", DataType="double")
cos_theta = Simulink.Signal(StorageClass="ExportedGlobal", DataType="double")
K1 = Simulink.Parameter(-4000, StorageClass="Define", DataType="double")
K2 = Simulink.Parameter(14000, StorageClass="Define", DataType="double")
Ts = Simulink.Parameter(0.0001, StorageClass="Define", DataType="double")  % PWM周期
Rs = Simulink.Parameter(0.62, StorageClass="Define", DataType="double")
Ld = Simulink.Parameter(0.001971, StorageClass="Define", DataType="double")
flux = Simulink.Parameter(0.08627, StorageClass="Define", DataType="double")
Lq = Simulink.Parameter(0.001971, StorageClass="Define", DataType="double")
PLL_P = Simulink.Parameter(5000, StorageClass="Define")
PLL_I = Simulink.Parameter(15000, StorageClass="Define")
gamma = Simulink.Parameter(4000, StorageClass="Define", DataType="single")
Sig1 = Simulink.Signal()